# Dynamo graph example-2.0.2-v1.dyn "test-2.0.2-v1" (Dynamo 2.0.2.6826)

number_slider = DoubleSlider(50, range=0..100 step 0.1)  # graph input
number_slider_2 = DoubleSlider(1, range=0..100 step 0.1)  # graph input
mul = number_slider * number_slider_2
watch = Watch(mul)
