# Dynamo graph example-2.0.2-v2.dyn "test-2.0.2-v2" (Dynamo 2.0.2.6826)

number_slider = DoubleSlider(50, range=0..100 step 0.1)  # graph input
number_slider_2 = DoubleSlider(25, range=0..100 step 0.1)  # graph input
mul = number_slider * number_slider_2
watch = Watch(mul)
div = mul / number_slider_2
watch_2 = Watch(div)
watch_3 = Watch(mul)
