# Dynamo graph example-v1.dyn (Dynamo 2.1.0.7500)

code_block = CodeBlock { 4; }
number_slider = DoubleSlider(20, range=0..50 step 1)
number_slider_2 = DoubleSlider(5, range=0..50 step 1)
mul = number_slider * number_slider_2
add = code_block + mul
