# Dynamo graph example-v2.dyn (Dynamo 2.1.0.7500)

code_block = CodeBlock { 4; }
number_slider = DoubleSlider(100, range=0..100 step 1)
number_slider_2 = DoubleSlider(5, range=0..50 step 1)
mul = number_slider * number_slider_2
sub = code_block - mul
watch = Watch(sub)
